# Grasshopper definition Example_AllClasses.gh (Grasshopper 1.0.7)
# plug-ins: HAL for Grasshopper

sessionsettings = SessionSettings()  # -> Data, DefaultSettings
number_slider = Slider(600, range=0..1000)  # disabled
number_slider_2 = Slider(300, range=0..1000)  # disabled
button = Button()  # disabled
trigger = Trigger(Interval=20, TimerInterval=20, Target=c_hugofollower)
trigger_2 = Trigger(Interval=20, TimerInterval=20, Target=c_hugofollower_2)  # disabled
c_hugofollower = CSharpScript(
    reset=Button(),
    xBound=Slider(600, range=0..1000),
    yBound=Slider(300, range=0..1000),
    Reference="C:\Users\Leo\source\repos\TreasureHunt\Library\bin\Debug\net4.8\TreasureHunt - Copie (2).dll")  # -> out, A, hbX, hbY, outputPlayerLoc, outputTreasureLoc, outputMsg, outputObstacle, outputWormhole; inputs reset: Boolean, xBound: Double, yBound: Double
# ---------- c_hugofollower: C# usings ----------
using TreasureHunt;
# ---------- c_hugofollower: C# ----------
    Rectangle3d wormholePreview = new Rectangle3d();
    if (reset || StaticGame == null)
    {

      // Initialize the static game
      StaticGame = new Game(xBound, yBound);

      // Initialize RandomNumberGenerator
      Random random = new Random(7897999);

      InstantiateHugoFollower(StaticGame, random, xBound, yBound);
      InstantiateTinPlayers(StaticGame, random, xBound, yBound);
      InstantiateZigzagPlayer(StaticGame, random, xBound, yBound);
      InstantiateSpiralMovementPlayer(StaticGame, random, xBound, yBound);
      InstantiateWormhole(StaticGame, random, xBound, yBound);
    }
    // Run the game
    StaticGame.UpdatePlayers();

    if (StaticGame.wormholeList.Count > 0) {
      // Preview wormhole
      Plane wormholePlane = Plane.WorldXY;
      wormholePlane.Origin = (Point3d) StaticGame.wormholeList[0].location;
      //wormholePreview = new Rectangle3d(wormholePlane, StaticGame.wormholeList[0].wormholeSize, StaticGame.wormholeList[0].wormholeSize);
      wormholePreview = new Rectangle3d(wormholePlane, 30, 30);
      
    }
    // Preview player locations
    List<Vector3d> playerLocations = new List<Vector3d>();

    for (int i = 0; i < StaticGame.playerList.Count; i++){
      playerLocations.Add(StaticGame.playerList[i].GetLocation());

    }
    // Preview player status messages
    List<string> playerMessages = new List<string>();

    for (int i = 0; i < StaticGame.playerList.Count; i++){
      playerMessages.Add(StaticGame.playerList[i].statusMessage);
    }


    // Get treasure location
    Vector3d treasureLocation = StaticGame.treasure.GetLocation();

    // Set GH output variables
    outputTreasureLoc = treasureLocation;
    outputMsg = playerMessages;
    outputPlayerLoc = playerLocations;
    if (wormholePreview is Rectangle3d){
      outputWormhole = wormholePreview;
    }
# ---------- c_hugofollower: C# additional code ----------
  public static Game StaticGame {get;set;}

  void InstantiateHugoFollower(Game game, Random random, double xBound, double yBound)
  {

    double randomX;
    double randomY;

    // INSTANTIATE A HugoFollower and a Player.
    randomX = random.NextDouble() * xBound;
    randomY = random.NextDouble() * yBound;
    // Instantiate the leader (simple player class)
    Player player1 = new Player(randomX, randomY);
    // Add it to the list of players belonging to the space.
    game.playerList.Add(player1);

    randomX = random.NextDouble() * xBound;
    randomY = random.NextDouble() * yBound;
    // Instantiate a follower
    HugoFollower player2 = new HugoFollower(player1);


    // Add it to the list of balls belonging to the space.
    game.playerList.Add(player2);

  }

  void InstantiateTinPlayers(Game game, Random random, double xBound, double yBound)
  {

    double randomX;
    double randomY;

    // INSTANTIATE A HugoFollower and a Player.
    randomX = random.NextDouble() * xBound;
    randomY = random.NextDouble() * yBound;
    // Instantiate the leader (simple player class)
    TinLeader player1 = new TinLeader(randomX, randomY);
    // Add it to the list of players belonging to the space.
    game.playerList.Add(player1);

    randomX = random.NextDouble() * xBound;
    randomY = random.NextDouble() * yBound;
    // Instantiate a follower
    TinFollower player2 = new TinFollower(randomX, randomY, xBound, yBound);


    // Add it to the list of balls belonging to the space.
    game.playerList.Add(player2);

  }

  void InstantiateZigzagPlayer(Game game, Random random, double xBound, double yBound)
  {
    double randomX;
    double randomY;

    // Generate random values for x , y position
    randomX = random.NextDouble() * xBound;
    randomY = random.NextDouble() * yBound;
    // Instantiate the zigzagplayer
    ZigzagPlayer player = new ZigzagPlayer(randomX, randomY, 0, 0, xBound, yBound);
    // Add it to the list of players belonging to the space.
    game.playerList.Add(player);


  }

  void InstantiateSpiralMovementPlayer(Game game, Random random, double xBound, double yBound)
  {
    double randomX;
    double randomY;

    // Generate random values for x , y position
    randomX = random.NextDouble() * xBound;
    randomY = random.NextDouble() * yBound;
    // Instantiate the zigzagplayer
    SpiralMovement player = new SpiralMovement(randomX, randomY);
    // Add it to the list of players belonging to the space.
    game.playerList.Add(player);


  }

  void InstantiateWormhole(Game game, Random random, double xBound, double yBound)
  {
    double wormholeX = random.NextDouble() * xBound;
    double wormholeY = random.NextDouble() * yBound;

    // Instantiate a wormhole
    WormHole wormhole = new WormHole(20, 20);

    // list of wormholes in the space board
    game.wormholeList.Add(wormhole);
  }

  void InstantiateObstacle(Game game, Random random, double xBound, double yBound)
  {
    double randomX = random.NextDouble() * xBound;
    double randomY = random.NextDouble() * yBound;

    Obstacle obstacle = new Obstacle(randomX, randomY, 20, 20);
    game.obstacles.Add(obstacle);

  }
# ---------- end c_hugofollower ----------
c_hugofollower_2 = CSharpScript(
    reset=button,
    xBound=number_slider,
    yBound=number_slider_2,
    Reference="C:\Users\Leo\source\repos\TreasureHunt\Library\bin\Debug\net4.8\TreasureHunt - Copie.dll")  # -> out, A, hbX, hbY, outputPlayerLoc, outputTreasureLoc, outputMsg; inputs reset: Boolean, xBound: Double, yBound: Double; disabled
# ---------- c_hugofollower_2: C# ----------
    if (reset || StaticGame == null)
    {


      // Initialize the static game
      StaticGame = new Game(xBound, yBound);

      // Generate and initialize the players
      Random random = new Random(7897999);

      double randomX;
      double randomY;


      randomX = random.NextDouble() * xBound;
      randomY = random.NextDouble() * yBound;
      // Instantiate a moving ball
      Player player1 = new Player(randomX, randomY);
      // Add it to the list of balls belonging to the space.
      StaticGame.playerList.Add(player1);

      randomX = random.NextDouble() * xBound;
      randomY = random.NextDouble() * yBound;
      // Instantiate a moving ball
      HugoFollower player2 = new HugoFollower(player1);
      
      //TinPlayer player2 = new TinPlayer(randomX, randomY);
      // Add it to the list of balls belonging to the space.
      StaticGame.playerList.Add(player2);


    }

    StaticGame.UpdatePlayers();

    List<Vector3d> playerLocations = new List<Vector3d>();

    for (int i = 0; i < StaticGame.playerList.Count; i++){
      playerLocations.Add(StaticGame.playerList[i].GetLocation());

    }

    List<string> playerMessages = new List<string>();

    for (int i = 0; i < StaticGame.playerList.Count; i++){
      playerMessages.Add(StaticGame.playerList[i].statusMessage);
    }

    Vector3d treasureLocation = StaticGame.treasure.GetLocation();
    outputTreasureLoc = treasureLocation;
    outputMsg = playerMessages;
    outputPlayerLoc = playerLocations;
# ---------- c_hugofollower_2: C# additional code ----------
  public static Game StaticGame {get;set;}
# ---------- end c_hugofollower_2 ----------
data = Data(c_hugofollower.outputWormhole)
pt = Point(c_hugofollower.outputPlayerLoc)
pt_2 = Point(c_hugofollower_2.outputPlayerLoc)  # disabled
pt_3 = Point(c_hugofollower.outputTreasureLoc)
pt_4 = Point(c_hugofollower_2.outputTreasureLoc)  # disabled
preview = CustomPreview(
    Geometry=pt_3,
    Material={diffuse=RGB(221, 160, 221), emission=RGB(66, 48, 66), shine=0.5, specular=RGB(255, 255, 255), transparency=0})
preview_2 = CustomPreview(
    Geometry=pt_4,
    Material={diffuse=RGB(221, 160, 221), emission=RGB(66, 48, 66), shine=0.5, specular=RGB(255, 255, 255), transparency=0})  # disabled
